# Grasshopper definition HW03_Rhino.gh (Grasshopper 1.0.7)

box = Box({Plane=PlaneXY(0.1995766968, 0.03612775967, 0), X=Domain(0, 21.64556464), Y=Domain(0, 11.38760777), Z=Domain(0, 24.23332665)})
rec = Rectangle(reverse({Plane=PlaneXY(10.86522791, 5.658089974, 0), Size=Domain2(u=-10.83288774..10.83288774, v=-5.611617389..5.611617389)}))
pop3d = Populate3D(Region=box, Count=100, Seed=1)
pop2d = Populate2D(Region=rec, Count=Slider(140, range=0..1000), Seed=1)
voronoi = Voronoi(Points=pop2d, Boundary=rec, BruteForceOverride=False)
voronoi³ = Voronoi3D(Points=pop3d, Box=box)  # -> Cells, Boundary
